# Grasshopper definition Spikey_hops.gh (Grasshopper 1.0.7)
# plug-ins: Hops

# https://github.com/iaac-macad/bimsc24-datamgmt-session01/raw/main/Session01/Spikey.gh
number_slider = Slider(10, range=0..10)
panel = Panel("D:\Master in Computation design\MODULE 2\data management\session 1\bimsc24-datamgmt-session01\Session01\Spikey_hops_def.gh")
hops = Hops(
    _Path=panel,
    CellRadius=number_slider,
    Count=Slider(56, range=0..1000),
    BranchLength=Slider(10, range=0..10),
    CacheResultsInMemory=True,
    CacheSolveResults=True,
    RemoteDefinitionLocation="D:\Master in Computation design\MODULE 2\data management\session 1\bimsc24-datamgmt-session01\Session01\Spikey_hops_def.gh",
    RemoteSolveVersion=(0, 1, 0),
    ShowInput_Enabled=False,
    ShowInput_Path=True,
    SynchronousSolve=False)  # -> Mesh, SubD
data = Data(hops.SubD)
data_2 = Data(hops.SubD)
